# Grasshopper definition street_node_v3.gh (Grasshopper 1.0.7)

number_slider = Slider(213, range=100..300)
number_slider_2 = Slider(65, range=50..150)
pt = ConstructPoint(XCoordinate="0", YCoordinate="0", ZCoordinate="0")
genes = GenePool(Decimals=0, Maximum=10, Minimum=2, Value=[4, 2, 5, 7, 7, 7, 4, 10])
# Street position
street_position = GetInteger(
    Slider(9, range=-10..10),
    AtLeast=1,
    AtMost=1,
    Maximum=10,
    Minimum=-10,
    Prompt="Enter Street Position (Distance from centre from -10m to 10m)")
# Number of levels
number_of_levels = GetInteger(
    Slider(6, range=2..20),
    AtLeast=1,
    AtMost=1,
    Maximum=20,
    Minimum=2,
    Prompt="Enter Number of Floors (must be between 2 and 20)")
# Street width
street_width = GetInteger(
    Slider(21, range=4..24),
    AtLeast=1,
    AtMost=1,
    Maximum=24,
    Minimum=4,
    Prompt="Enter Street Width (must be between 4m and 24m)")
# Site Dimensions
site_length = GetInteger(number_slider, AtLeast=1, AtMost=1, Maximum=300, Minimum=150, Prompt="Enter Site Length (between 150m and 300m)")
# Building Depth
# Position of Building Gap
building_depth = GetInteger(
    Slider(18, range=12..24),
    AtLeast=1,
    AtMost=1,
    Maximum=24,
    Minimum=12,
    Prompt="Enter Building depth (must be between 12m and 24m)")
# Floor Height (m)
floor_height = GetInteger(
    Slider(4, range=3..6),
    AtLeast=1,
    AtMost=1,
    Maximum=6,
    Minimum=3,
    Prompt="Enter Floor height (must be between 3m and 6m)")
# Street angle
street_angle = GetInteger(
    Slider(-35, range=-35..35),
    AtLeast=1,
    AtMost=1,
    Maximum=35,
    Minimum=-35,
    Prompt="Enter Street Angle (must be between -35 and 35 degrees)")
site_width = GetInteger(number_slider_2, AtLeast=1, AtMost=1, Maximum=150, Minimum=50, Prompt="Enter Site Width (between 50m and 150m)")
# Width between Buildings (m)
gap_width_between_buildings = GetInteger(
    Slider(12, range=4..15),
    AtLeast=1,
    AtMost=1,
    Maximum=15,
    Minimum=4,
    Prompt="Enter Gap size between buildings (must be between 4m and 15m)")
# Podium Height (m)
podium_height = GetInteger(
    Slider(10, range=3..12),
    AtLeast=1,
    AtMost=1,
    Maximum=12,
    Minimum=3,
    Prompt="Enter Podium height (must be between 3m and 12m)")
# Site Location
panel = Panel("2")
division = Division(A=number_slider_2, B="2")
division_2 = Division(A=number_slider, B=panel)
pt_2 = ConstructPoint(XCoordinate=expr("-x", division_2), YCoordinate=expr("-x", division), ZCoordinate=0)
rectangle = Rectangle(Plane=pt_2, XSize=site_length, YSize=site_width, Radius=0)  # -> Rectangle, Length
area = Area(Geometry=rectangle.Rectangle)  # -> Area, Centroid
X = UnitX(Factor=street_position)
neg = Negative(Value=site_width)
xz = XZPlane(Origin=Point(0, 0, 0))
move = Move(Geometry=area.Centroid, Motion=X)  # -> Geometry, Transform
pln = Plane(move.Geometry)
line = LineSDL(Start=pln, Direction=xz, Length=[site_width, neg])
join = JoinCurves(Curves=line, Preserve=False)
rotate = Rotate(Geometry=join, Angle=degrees(street_angle), Plane=pln)  # -> Geometry, Transform
multiplication = Multiplication(A=street_width, B=0.5)
multiplication_2 = Multiplication(A=street_width, B=-0.5)
offset = OffsetCurve(Curve=rotate.Geometry, Distance=[multiplication_2, multiplication], Corners=1)
end = EndPoints(Curve=flatten(offset))  # -> Start, End
item = ListItem(List=end.End, Index=0, Wrap=True)  # -> Item, Item1
item_2 = ListItem(List=end.Start, Index=0, Wrap=True)  # -> Item, Item1
ln = Line(StartPoint=item.Item, EndPoint=item.Item1)
ln_2 = Line(StartPoint=item_2.Item, EndPoint=item_2.Item1)
join_2 = JoinCurves(Curves=flatten([offset, ln_2, ln]), Preserve=False)
rdiff = RegionDifference(CurvesA=rectangle.Rectangle, CurvesB=join_2)  # -> graft(Result)
offset_2 = OffsetCurve(Curve=rdiff, Distance=expr("-x", building_depth), Corners=1)
pshift = ShiftPaths(Data=offset_2, Offset=-1)
explode = Explode(Curve=pshift, Recursive=True)  # -> Segments, Vertices
flip = FlipCurve(Curve=explode.Segments)  # -> Curve, Flag
crv = Curve(explode.Segments)
multiplication_3 = Multiplication(A=gap_width_between_buildings, B=-0.5)
multiplication_4 = Multiplication(A=gap_width_between_buildings, B=0.5)
eval = EvaluateLength(Curve=explode.Segments, Length=multiplication_4, Normalized=False)  # -> Point, Tangent, Parameter
eval_2 = EvaluateLength(Curve=flip.Curve, Length=multiplication_4, Normalized=False)  # -> Point, Tangent, Parameter
ln_3 = Line(StartPoint=eval.Point, EndPoint=eval_2.Point)
eval_3 = EvaluateCurve(Curve=reparameterize(ln_3), Parameter=Slider(0.5, range=0..1))  # -> Point, Tangent, Angle
crv_cp = CurveClosestPoint(Point=eval_3.Point, Curve=crv)  # -> Point, Parameter, Distance
pframe = PerpFrame(Curve=crv, Parameter=crv_cp.Parameter)
deplane = DeconstructPlane(Plane=pframe)  # -> Origin, XAxis, YAxis, ZAxis
pl = ConstructPlane(Origin=deplane.Origin, XAxis=deplane.ZAxis, YAxis=deplane.XAxis)
line_2 = LineSDL(Start=pframe, Direction=pl, Length=expr("x+1", building_depth))
number_slider_3 = Slider(1, range=0..1)
offset_3 = OffsetCurve(Curve=graft(line_2), Distance=flatten([multiplication_3, multiplication_4]), Corners=1)
ext = ExtendCurve(Curve=offset_3, Type=expr("0", 0), Start=number_slider_3, End=number_slider_3)
end_2 = EndPoints(Curve=simplify(offset_3))  # -> Start, End
flatten = FlattenTree(Tree=end_2.End, Path="{0}")
flatten_2 = FlattenTree(Tree=end_2.Start, Path="{0}")
partition = PartitionList(List=flatten, Size=2)
partition_2 = PartitionList(List=flatten_2, Size=2)
item_3 = ListItem(List=partition_2, Index=0, Wrap=True)  # -> Item, Item1
item_4 = ListItem(List=partition, Index=0, Wrap=True)  # -> Item, Item1
ln_4 = Line(StartPoint=item_3.Item, EndPoint=item_3.Item1)
ln_5 = Line(StartPoint=item_4.Item, EndPoint=item_4.Item1)
srf = Surface(rdiff)
loft = Loft(Curves=[pshift, rdiff], Options={Adjust=False, Closed=False, LoftEnds=0, LoftSimp=0, LoftType=0, Rebuild=10, Refit=0.01})  # -> graft(Loft)
edges = BrepEdges(Brep=loft)  # -> Naked, Interior, NonManifold
crv_2 = Curve(edges.Naked)
join_3 = JoinCurves(Curves=flatten([ln_4, ln_5, offset_3]), Preserve=False)
crv_3 = Curve(crv_2)
boundary = BoundarySurfaces(Edges=crv_3)
srfsplit = SurfaceSplit(Surface=boundary, Curves=join_3)  # -> simplify(Fragments)
sort = SortList(Keys=srfsplit, ValuesA=srfsplit)  # -> Keys, ValuesA
item_5 = ListItem(List=sort.ValuesA, Index=0, Wrap=True)
area_2 = Area(Geometry=srfsplit)  # -> Area, Centroid
area_3 = Area(Geometry=item_5)  # -> Area, Centroid
round = Round(Number=area_3.Area)  # -> Nearest, Floor, Ceiling
larger = LargerThan(FirstNumber=area_2.Area, SecondNumber=expr("x+1", round.Ceiling))  # -> LargerThan, OrEqualTo
cull = CullPattern(List=srfsplit, CullPattern=larger.LargerThan)
srf_2 = Surface(cull)
group = Group(Objects=srf_2)
graft = GraftTree(Tree=srf_2, IncludeEmptyLists=True, IncludeNullItems=True)
series = Series(Start=podium_height, Step=floor_height, Count=number_of_levels)
crv_4 = Curve(graft)
Z = UnitZ(Factor=series)
repeat = RepeatData(Data=floor_height, Length=number_of_levels)
move_2 = Move(Geometry=crv_4, Motion=Z)  # -> simplify(Geometry), Transform
crv_5 = Curve(flatten(srf_2))
addition = Addition(A=podium_height, B="0.1")
join_4 = JoinCurves(Curves=crv_5, Preserve=False)
lng = ListLength(List=move_2.Geometry)
Z_2 = UnitZ(Factor=addition)
series_2 = Series(Start=0, Step=1, Count=lng)
Z_3 = UnitZ(Factor=1)
move_3 = Move(Geometry=join_4, Motion=Z_2)  # -> Geometry, Transform
Z_4 = UnitZ(Factor=podium_height)
replace = ReplaceItems(List=move_2.Geometry, Item=repeat, Indices=series_2, Wrap=False)
crv_6 = Curve(simplify(flatten(rdiff)))
join_5 = JoinCurves(Curves=crv_6, Preserve=False)
move_4 = Move(Geometry=join_5, Motion=Z_2)  # -> Geometry, Transform
rdiff_2 = RegionDifference(CurvesA=move_4.Geometry, CurvesB=move_3.Geometry)
amp = Amplitude(Vector=Z_3, Amplitude=replace)  # -> simplify(Vector)
swatch = Red(SwatchColor=RGB(15, 150, 26))
extr = Extrude(Base=move_2.Geometry, Direction=amp)
srf_3 = Surface(rdiff_2)
pshift_2 = ShiftPaths(Data=extr, Offset=-1)
mesh_join = MeshJoin(Meshes=srf_3)
extr_2 = Extrude(Base=crv_6, Direction=Z_4)  # -> graft(Extrusion)
area_4 = Area(Geometry=srf_3)  # -> Area, Centroid
integer = Integer(area_4.Area)
ins = InsertItems(List=pshift_2, Item=extr_2, Indices="0", Wrap=True)
cap = CapHoles(Brep=ins)
viewer = ParamViewer(ins)
bang = ExplodeTree(Data=cap)  # -> Branch0, Branch1
mcol = MeshColours(Mesh=mesh_join, Colours=swatch)
mass_addition = MassAddition(Input=integer)  # -> Result, PartialResults
edges_2 = BrepEdges(Brep=cap)  # -> Naked, Interior, NonManifold
mcol_2 = MeshColours(Mesh=bang.Branch0, Colours=ColourSwatch(SwatchColor=RGB(255, 0, 0)))
mcol_3 = MeshColours(Mesh=bang.Branch1, Colours=ColourSwatch(SwatchColor=RGB(0, 98, 255)))
mesh_join_2 = MeshJoin(Meshes=mcol_3)
mesh_join_3 = MeshJoin(Meshes=mcol_2)
area_5 = Area(Geometry=rdiff)  # -> flatten(Area), Centroid
merge = Merge(Data2=mesh_join_2)  # -> flatten(Result)
area_6 = Area(Geometry=move_2.Geometry)  # -> flatten(Area), Centroid
mass_addition_2 = MassAddition(Input=area_5.Area)  # -> Result, PartialResults
mesh_join_4 = MeshJoin(Meshes=merge)
panel_2 = Panel(mass_addition.Result)
mass_addition_3 = MassAddition(Input=area_6.Area)  # -> Result, PartialResults
merge_2 = Merge(Data1=edges_2.Naked, Data2=edges_2.Interior)  # -> flatten(Result)
integer_2 = Integer(flatten(mass_addition_2.Result))
panel_3 = Panel(integer_2)
integer_3 = Integer(flatten(mass_addition_3.Result))
panel_4 = Panel(integer_3)
c_script = CSharpScript(mesh=mcol, terrace_area=panel_2)  # -> out, A; inputs mesh: Mesh
# ---------- c_script: C# ----------
    
    mesh.SetUserString("terrace area", terrace_area.ToString());
    

    A = mesh;
# ---------- end c_script ----------
context_bake = ContextBake(Mesh_terrace=c_script.A)
context_bake_2 = ContextBake(Geometry=merge_2)
c_script_2 = CSharpScript(mesh=mesh_join_4, podium_area=integer_2)  # -> out, A; inputs mesh: Mesh, podium_area: Int32
# ---------- c_script_2: C# ----------
    Print(podium_area.ToString());

    mesh.SetUserString("podium area", podium_area.ToString());
 

    A = mesh;
# ---------- end c_script_2 ----------
c_script_3 = CSharpScript(mesh=mesh_join_3, apartment_area=integer_3)  # -> out, A; inputs mesh: Mesh
# ---------- c_script_3: C# ----------
 

    mesh.SetUserString("apartment area", apartment_area.ToString());

    A = mesh;
# ---------- end c_script_3 ----------
context_bake_3 = ContextBake(Mesh_buildings_2=c_script_2.A)
context_bake_4 = ContextBake(Mesh_buildings_1=c_script_3.A)
